# Grasshopper definition evaluate-adlerML.gh (Grasshopper 1.0.7)
# plug-ins: AdlerML, Vox, Human, jSwan

subd = SubD(<subd referenced from the Rhino model>)
subd_2 = SubD(<subd referenced from the Rhino model>)
box = Box({Plane=PlaneXY(-3.972176717, -4.607704968, -15.75076222), X=Domain(-40.57070184, 64.40376214), Y=Domain(-35.18645772, 62.83268753), Z=Domain(0.0161347954, 94.4884385)})
meshsubd = MeshFromSubD(SubD=subd, Density=2)
vec = VectorXYZ(XComponent="5", YComponent="5", ZComponent="5")  # -> Vector, Length
meshsubd_2 = MeshFromSubD(SubD=subd_2, Density=2)
vec_2 = VectorXYZ(XComponent="5", YComponent="5", ZComponent="5")  # -> Vector, Length
voxelsh = VoxelizeMeshSH(Mesh=meshsubd, VoxelSize=vec.Vector, Bounds=box)
voxelsh_2 = VoxelizeMeshSH(Mesh=meshsubd_2, VoxelSize=vec_2.Vector, Bounds=box)

# ---- group: Encoder
path = FilePath("F:\lab\3d-autoencoder\data\model\onnx\241130061555\encoder.onnx")
session = CreateSession(ModelPath=path, Device=Slider(1, range=0..1))

# ----
genes = GenePool(
    Decimals=2,
    Maximum=10,
    Minimum=-10,
    Value=[-1.65, 5.81, 2.32, 5.9, -1.82, -0.78, 6.35, 6.58, -6.7, 3.18, 2.63, -0.93, 3.07, -3.34, 0.89, -5.14])
serializevoxelgrid = SerializeVoxelGrid(VoxelGrid=voxelsh_2, ExtractParts="2")  # -> Serialized1D, Serialized3D
serializevoxelgrid_2 = SerializeVoxelGrid(VoxelGrid=voxelsh, ExtractParts="2")  # -> Serialized1D, Serialized3D
dejson = DeserializeJson(JSON=serializevoxelgrid.Serialized1D, OutputsLocked=False)
dejson_2 = DeserializeJson(JSON=serializevoxelgrid_2.Serialized1D, OutputsLocked=False)

# ---- group: Decoder
path_2 = FilePath("F:\lab\3d-autoencoder\data\model\onnx\241130061555\decoder.onnx")
session_2 = CreateSession(ModelPath=path_2, Device=Slider(1, range=0..1))

# ----
number_slider = Slider(5, range=0..10)
ae_inf = AEInference(Session=session, Latent=dejson_2)
ae_inf_2 = AEInference(Session=session, Latent=dejson)
interpnum = InterpolateNumber(Start=ae_inf, End=ae_inf_2, Parameter=Slider(1, range=0..1))
vec_3 = VectorXYZ(XComponent=Slider(22, range=0..100), YComponent=Slider(20, range=0..100), ZComponent=Slider(20, range=0..100))  # -> Vector, Length
vec_4 = VectorXYZ(XComponent=number_slider, YComponent=number_slider, ZComponent=number_slider)  # -> Vector, Length

# ---- group: decoder
ae_inf_3 = AEInference(Session=session_2, Latent=interpnum)
lng = ListLength(List=ae_inf_3)
output_dimension = Panel(lng)

# ----
nickname = CreateVoxelGrid(GridDim=vec_3.Vector, VoxelSize=vec_4.Vector, Origin=Point(0, 0, 0))
int = Integer(ae_inf_3)
meta = GetRuntimeMeta(Session=session_2)  # -> InputMetas, OutputMetas
setvg_1d = SetVoxelGrid1D(VoxelGrid=voxelsh, Occupancy=int)
panel = Panel(meta.OutputMetas)
panel_2 = Panel(meta.InputMetas)
evalvg = EvaluateVoxelGrid(VoxelGrid=setvg_1d, States="1")  # -> VoxelPos, VoxelSize, States
voxmesh = VoxelMesher(VoxelPos=evalvg.VoxelPos, VoxelSize=evalvg.VoxelSize, Algorithm=1)
medges = MeshEdges(Mesh=voxmesh)  # -> NakedEdges, InteriorEdges, NonManifoldEdges
preview = CustomPreview(
    Geometry=voxmesh,
    Material={diffuse=RGB(221, 160, 221), emission=RGB(66, 48, 66), shine=0.5, specular=RGB(255, 255, 255), transparency=0})
previewlw = CustomPreviewLineweights(Geometry=medges.InteriorEdges, Shader=ColourSwatch(SwatchColor=RGB(255, 255, 255)), Absolute=False)
