# Grasshopper definition evaluate.gh (Grasshopper 1.0.7)
# plug-ins: Portal, Vox, Heteroptera

# ---- group: Volume
box = Box({Plane=PlaneXY(0, 0, 0), X=Domain(-27.04713456, 42.93584143), Y=Domain(-23.45763848, 41.88845835), Z=Domain(0.01075653027, 62.99229233)})
center = Center(Geometry=box)  # -> Center, Dimension
scale = Scale(Geometry=box, Center=center.Center, Factor=Slider(1.5, range=0..10))  # -> Geometry, Transform

# ----
number_slider = Slider(24, range=0..100)
number_slider_2 = Slider(5, range=0..10)
vec = VectorXYZ(XComponent=number_slider, YComponent=number_slider, ZComponent=number_slider)  # -> Vector, Length
vec_2 = VectorXYZ(XComponent=number_slider_2, YComponent=number_slider_2, ZComponent=number_slider_2)  # -> Vector, Length
number_slider_3 = Slider(5, range=0..10)
number_slider_4 = Slider(10, range=0..10)
nickname = CreateVoxelGridDim(GridDim=vec.Vector, VoxelSize=vec_2.Vector, Origin=Point(0, 0, 0))
number_slider_5 = Slider(24, range=0..100)
number_slider_6 = Slider(22, range=0..100)
trigger = Trigger(Interval=-1, TimerInterval=5, Target=[file_2, file])  # disabled
number_slider_7 = Slider(24, range=0..100)
number_slider_8 = Slider(5, range=0..10)
path = FilePath("F:\lab\3d-autoencoder\data\inference\output\inference_output_thresholded.json")
path_2 = FilePath("F:\lab\3d-autoencoder\data\inference\input\inference")
write = Button()
file = FileReader(FilePath=path)
file_2 = FileReader(FilePath=path_2)
neg = Negative(Value=Slider(55, range=0..100))
deb = BytesDecoder(Bytes=file)
vec_3 = VectorXYZ(XComponent=number_slider_7, YComponent=number_slider_7, ZComponent=number_slider_7)  # -> Vector, Length
pt = ConstructPoint(XCoordinate=neg, YCoordinate=neg, ZCoordinate=0)
deb_2 = BytesDecoder(Bytes=file_2)
vec_4 = VectorXYZ(XComponent=number_slider_8, YComponent=number_slider_8, ZComponent=number_slider_8)  # -> Vector, Length
nickname_2 = CreateVoxelGridDim(GridDim=vec_3.Vector, VoxelSize=vec_4.Vector, Origin=pt)
nickname_3 = DeserializeVoxelGrid(SerializedJSON=deb_2)
nickname_4 = DeserializeVoxelGrid(SerializedJSON=deb)
# Normalize
# Normalize
# Normalize
# Normalize
# Normalize
# Normalize
vec_5 = VectorXYZ(XComponent=number_slider_3, YComponent=number_slider_3, ZComponent=number_slider_3)  # -> Vector, Length
evalvg = EvaluateVoxelGrid(VoxelGrid=nickname_3, States=Slider(1, range=0..1))  # -> VoxelPos, VoxelSize, Bounds, Dimension
evalvg_2 = EvaluateVoxelGrid(VoxelGrid=nickname_4, States=Slider(1, range=0..1))  # -> VoxelPos, VoxelSize, Bounds, Dimension
lng = ListLength(List=evalvg.VoxelPos)
lng_2 = ListLength(List=evalvg_2.VoxelPos)
dup = DuplicateData(Data=vec_5.Vector, Number=lng, Order=True)
dup_2 = DuplicateData(Data=vec_5.Vector, Number=lng_2, Order=True)
python = GhPythonScript(x=evalvg_2.VoxelPos, y=evalvg.VoxelPos)  # -> out, a; inputs x: list of Point3d, y: list of Point3d
# ---------- python: Python ----------
import rhinoscriptsyntax as rs

match_count = 0

for x1 in x:
    for y1 in y:
        if x1 == y1:
            match_count+=1
ratio = match_count / len(x) * 100
a = str(ratio) + "%"
# ---------- end python ----------
match_rate = Panel(python.a)
voxmesh = VoxelMesher(VoxelPos=evalvg.VoxelPos, VoxelSize=dup, Algorithm=Slider(1, range=0..10))
voxmesh_2 = VoxelMesher(VoxelPos=evalvg_2.VoxelPos, VoxelSize=dup_2, Algorithm=Slider(1, range=0..10))
panel = Panel("grid_22x20x20")
preview = CustomPreview(Geometry=voxmesh_2, Material=ColourSwatch(SwatchColor=RGB(115, 147, 255)))
preview_2 = CustomPreview(Geometry=voxmesh, Material=ColourSwatch(SwatchColor=RGB(255, 164, 115)))

# ----
# Evaluate with new geometry
subd = SubD(<subd referenced from the Rhino model>)
meshsubd = MeshFromSubD(SubD=subd, Density=2)
mesh = Mesh(meshsubd)
path_3 = FilePath("F:\lab\3d-autoencoder\data\inference\input\")
concat = Concatenate(FragmentA=path_3, FragmentB="inference")

voxelsh = VoxelizeMeshSH(Mesh=mesh, VoxelGrid=nickname_2)
evalvg_3 = EvaluateVoxelGrid(VoxelGrid=voxelsh, States=1)  # -> VoxelPos, VoxelSize, Bounds, Dimension
serializevoxelgrid = SerializeVoxelGrid(VoxelGrid=voxelsh, ExtractParts=Slider(0, range=0..10), AsInt=False)  # -> Serialized1D, Serialized3D
edges = BrepEdges(Brep=evalvg_3.Bounds)  # -> Naked, Interior, NonManifold
concat_2 = Concatenate(FragmentA=path_3, FragmentB="inference", FragmentC="_3d")
file_3 = FileWriter(Bytes=serializevoxelgrid.Serialized3D, FilePath=concat_2, Write=write)

file_4 = FileWriter(Bytes=serializevoxelgrid.Serialized1D, FilePath=concat, Write=write)
