# Grasshopper definition generate_data.gh (Grasshopper 1.0.7)
# plug-ins: Chimera, Heteroptera, Portal, Vox, Pufferfish

number_slider = Slider(50, range=0..100)
number_slider_2 = Slider(5, range=0..10)
number_slider_3 = Slider(2, range=0..10)
vec = VectorXYZ(XComponent=number_slider, YComponent=number_slider, ZComponent=number_slider)  # -> Vector, Length
vec_2 = VectorXYZ(XComponent=number_slider_3, YComponent=number_slider_3, ZComponent=number_slider_3)  # -> Vector, Length
vec_3 = VectorXYZ(XComponent=number_slider_2, YComponent=number_slider_2, ZComponent=number_slider_2)  # -> Vector, Length
box = Box({Plane=PlaneXY(-3.972176717, -4.607704968, -15.75076222), X=Domain(-40.57070184, 64.40376214), Y=Domain(-35.18645772, 62.83268753), Z=Domain(0.0161347954, 94.4884385)})
nickname = CreateVoxelGridDim(GridDim=vec.Vector, VoxelSize=vec_2.Vector, Origin=Point(0, 0, 0))
nickname_2 = CreateVoxelGridBounds(VoxelSize=vec_3.Vector, Bounds=box)
mesh = Mesh([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])
evalvg = EvaluateVoxelGrid(VoxelGrid=nickname, States=1)  # -> VoxelPos, VoxelSize, Bounds, Dimension
center = Center(Geometry=mesh, forall=True)  # -> Center, Dimension
interval = Slider(50, range=50..15000)
box_2 = Box(evalvg.Bounds)

# ---- group: Master iterator
toggle = BooleanToggle(False)
counter = MK_Counter(Run=toggle, StartNumber=0, TargetNumber=Slider(9999, range=0..10000), Interval=interval)

# ----
center_2 = Center(Geometry=box_2)  # -> Center, Dimension
move2pt = MoveToPoint(Geometry=mesh, PointA=center.Center, PointB=center_2.Center)  # -> Moved, Vector, Transform
lng = ListLength(List=move2pt.Moved)
x_minus_one = XMinusOne(NumberX=lng)
python = GhPythonScript(counter=counter)  # -> seed
# ---------- python: Python ----------
import rhinoscriptsyntax as rs
import random

seed = random.randint(0,100000)
# ---------- end python ----------

# ---- group: Mesh Selection
cluster = Cluster(A=0, B=x_minus_one, N=1, S=python)
item = ListItem(List=move2pt.Moved, Index=cluster, Wrap=True)

# ----
center_3 = Center(Geometry=item)  # -> Center, Dimension
python_2 = GhPythonScript(counter=python)  # -> seed; same code as python
python_3 = GhPythonScript(counter=python)  # -> seed; same code as python

# ---- group: Rotation
neg = Negative(Value="1")
cluster_2 = Cluster(A=neg, B="1", N=Slider(3, range=0..10), S=python_2)
item_2 = ListItem(List=cluster_2, Index=0, Wrap=True)  # -> Item, Item1, Item2
cluster_3 = Cluster(A="-180", B="180", N=1, S=python_3)
vec_4 = VectorXYZ(XComponent=item_2.Item, YComponent=item_2.Item1, ZComponent=item_2.Item2)  # -> Vector, Length
rot3d = Rotate3D(Geometry=item, Angle=degrees(cluster_3), Center=center_3.Center, Axis=vec_4.Vector)  # -> Geometry, Transform

# ----
python_4 = GhPythonScript(counter=python)  # -> seed; same code as python

# ---- group: Scale
cluster_4 = Cluster(A="0.8", B="1.5", N=1, S=python_4)
scale = Scale(Geometry=rot3d.Geometry, Center=center_3.Center, Factor=cluster_4)  # -> Geometry, Transform

# ----
python_5 = GhPythonScript(counter=python)  # -> seed; same code as python

# ---- group: Translation
python_6 = GhPythonScript(counter=python)  # -> seed; same code as python
neg_2 = Negative(Value="1")
cluster_5 = Cluster(A=neg_2, B="1", N=Slider(3, range=0..10), S=python_6)
item_3 = ListItem(List=cluster_5, Index=0, Wrap=True)  # -> Item, Item1, Item2
cluster_6 = Cluster(A=0, B="30", N=1, S=python_5)
vec_5 = VectorXYZ(XComponent=item_3.Item, YComponent=item_3.Item1, ZComponent=item_3.Item2)  # -> Vector, Length
amp = Amplitude(Vector=vec_5.Vector, Amplitude=cluster_6)
move = Move(Geometry=scale.Geometry, Motion=amp)  # -> Geometry, Transform

# ---- group: Deformation
python_7 = GhPythonScript(counter=python)  # -> seed; same code as python
python_8 = GhPythonScript(counter=python)  # -> seed; same code as python
cluster_7 = Cluster(A=0, B="5", N=1, S=python_7)
demesh = DeconstructMesh(Mesh=move.Geometry)  # -> Vertices, Faces, Colours, Normals
popgeo = PopulateGeometry(Geometry=move.Geometry, Count=cluster_7, Seed=python_8)
cp = ClosestPoint(Point=demesh.Vertices, Cloud=popgeo)  # -> ClosestPoint, CPIndex, Distance
bnd = Bounds(Numbers=cp.Distance)
remap = RemapNumbers(Value=cp.Distance, Source=bnd, Target=Domain(0, 1))  # -> Mapped, Clipped
python_9 = GhPythonScript(counter=python)  # -> seed; same code as python
graph = GraphMapper(
    remap.Mapped,
    x0=0,
    x1=1,
    y0=0,
    y1=1,
    container_name="Bezier",
    cpx=[0, 0.686506927, 0.2410549074, 1],
    cpy=[1, 0.777626574, 0.3535505533, 0])
cluster_8 = Cluster(A=0, B="8", N=1, S=python_9)
multiplication = Multiplication(A=graph, B=cluster_8)
multiplication_2 = Multiplication(A=demesh.Normals, B=multiplication)
move_2 = Move(Geometry=demesh.Vertices, Motion=multiplication_2)  # -> Geometry, Transform
conmesh = ConstructMesh(Vertices=move_2.Geometry, Faces=demesh.Faces)

# ----
cluster_9 = Cluster(A=0, B=1, N=1, S=2)
voxelsh = VoxelizeMeshSH(Mesh=conmesh, VoxelGrid=nickname)
devec = DeconstructVector(Vector=evalvg.Dimension)  # -> XComponent, YComponent, ZComponent
evalvg_2 = EvaluateVoxelGrid(VoxelGrid=voxelsh, States=1)  # -> VoxelPos, VoxelSize, Bounds, Dimension
concat = Concatenate(
    FragmentA=devec.XComponent,
    FragmentB="x",
    FragmentC=devec.YComponent,
    FragmentD="x",
    FragmentE=devec.ZComponent,
    FragmentF="\")
serializevoxelgrid = SerializeVoxelGrid(VoxelGrid=voxelsh, ExtractParts="2", AsInt=Toggle(False))  # -> Serialized1D, Serialized3D

# ---- group: Voxel export
concat_2 = Concatenate(
    FragmentA="F:\lab\3d-autoencoder\data\train\",
    FragmentD=concat,
    FragmentE="raw\",
    FragmentB="voxels_",
    FragmentC=counter)
enb = BytesEncoder(Text=serializevoxelgrid.Serialized1D, Compress=False)
file = FileWriter(Bytes=enb, FilePath=concat_2, Write=toggle)

# ----
panel = Panel(concat_2)

# ==== cluster Cluster
A = ClusterInput()
B = ClusterInput()
N = ClusterInput()
S = ClusterInput()
dom = ConstructDomain(DomainStart=A, DomainEnd=B)
random = Random(Range=dom, Number=N, Seed=S, Integers=False)
R = ClusterOutput(random)
